# Grasshopper definition FinalProject_part5.gh (Grasshopper 1.0.7)
# plug-ins: Karamba3D, DSUtilities

xy = XYPlane(Origin=Point(0, 0, 0))
yz = YZPlane(Origin=Point(0, 0, 0))
xz = XZPlane(Origin=Point(0, 0, 0))
list = ValueList({"Zero": 0, "One": 1, "Two": 2}, selected="Zero")
number_slider = Slider(51, range=10..100)
filter = StreamFilter(Gate=list, Stream0=xy, Stream1=yz, Stream2=xz)
expression = Expression(x=number_slider, Expression="0.17*sqrt(x)")
expression_2 = Expression(x=number_slider, Expression="4700*sqrt(x)")
# Python
topopt_python = GhPythonScript(fc=number_slider)  # -> out
# ---------- topopt_python: Python ----------
__author__ = "pitipatw"
__version__ = "2023.03.10"

import rhinoscriptsyntax as rs
import ghpythonlib.treehelpers as th
import json

# assign static values
output = dict() 
output["fc"] = fc

print(json.dumps(output))
# ---------- end topopt_python ----------
rectangle = Rectangle(Plane=filter, XSize=Slider(200, range=0..500), YSize=Slider(375, range=0..500), Radius=0)  # -> Rectangle, Length
panel = Panel(topopt_python)
e_mpa = Panel(expression_2)

# ---- group: WebSockets for Julia
server_port = Panel("ws://127.0.0.1:2000/")
websocket_client_start = WebsocketClientStart(Address=server_port, InitalMessage=topopt_python, Reset=False)
websocket_client_receiver = WebsocketClientReceiver(WebsocketObjects=websocket_client_start, AutoUpdate=Toggle(True))  # -> Message, Status
panel_2 = Panel(websocket_client_receiver.Status)
panel_3 = Panel(websocket_client_receiver.Message)

# ----
pt = ConstructPoint(XCoordinate=Slider(105, range=0..500), YCoordinate=Slider(54, range=0..500), ZCoordinate=Slider(0, range=0..500))
e_steel_mpa = Number("200000")
fc_mpa = Number(number_slider)
e_mpa_2 = Number(expression_2)
fy_mpa = Number("420")
division = Division(A=e_mpa, B="10")
expression_3 = Expression(E=division, v="0.3", Expression="E/(2*(1+v))")
division_2 = Division(A=Slider(67, range=0..500), B="2")
circle = CircleCNR(Center=pt, Normal=filter, Radius=division_2)
matselect = MaterialSelectionKaramba3D(menu=[dropdown(7), dropdown(4)])
matprops = MaterialPropertiesKaramba3D(
    FamilyOfMaterial="Steel",
    Name="myConcrete",
    YoungsModulus_kN_cm2=division,
    InPlaneShearModulus_kN_cm2=expression_3,
    TransverseShearModulus_kN_cm2=expression_3,
    SpecificWeight_kN_m3="24",
    CoefficientOfThermalExpansion_1_C=1.2e-05,
    TensileStrength_kN_cm2=expr("x/10", expression),
    CompressiveStrength_kN_cm2=expr("-x/10", number_slider),
    StrengthHypothesis="MISES",
    mode="Isotrop")
merge = Merge()

section = Section(Solids=rectangle.Rectangle, Voids=circle, YoungsModulus=e_mpa_2, AnalysisPlane=0)  # -> Section, Geometry
sectionprops = SectionProperties(Section=section.Section, Tolerance=0.01, MaxIter=50)  # -> Centroid, Area, Height, Width, Istrong, Iweak, SstrongTop, SstrongBottom, SweakRight, SweakLeft

section_2 = Section(Solids=circle, YoungsModulus=e_steel_mpa, AnalysisPlane=0)  # -> Section, Geometry
sectionprops_2 = SectionProperties(Section=section_2.Section, Tolerance=0.01, MaxIter=50)  # -> Centroid, Area, Height, Width, Istrong, Iweak, SstrongTop, SstrongBottom, SweakRight, SweakLeft

panel_4 = Panel(matselect)
panel_5 = Panel(matprops)
python = GhPythonScript(Msg=websocket_client_receiver.Message)  # -> out, a; inputs points: tree
# ---------- python: Python ----------
__author__ = "pitipatw"
__version__ = "2023.04.14"

import rhinoscriptsyntax as rs
import ghpythonlib.treehelpers as th
import json

df = json.loads(Msg)
GWP = df["GWP"]
# ---------- end python ----------
expression_4 = Expression(Expression="Format(\"{0}, {1}\", x, y)")
dfroma = DepthFromArea(Section=section.Section, Direction=-1, RelativeTolerance=0.05, MaximumIterations=250)  # -> Depth, RelativeError, Region
analyze = AnalyzeKaramba3D()  # -> CalculatedModel, MaximumDisplacement_cm, ResultingForceOfGravity_kN, ElasticEnergyChange_kNm
# 4 | Visualization
panel_6 = Panel("1")  # disabled
